vi "index.gviweb"   [LabVIEW NXG 3.1.0]
panel controls:
  "Height Offset of Box": f64 = 0.5
  "Button": bool
  "Tab": i32
  "Hyperlink Control": string = "https://sketchfab.com/models/031875966a5740f18ac4cffa8b14031d#"
  "Hyperlink Control_2": string = "https://medium.com/arjs/augmented-reality-in-10-lines-of-html-4e193ea9fdbf"
uses:
  AugmentedReality::Support::AugmentedReality.jsli::Replace Control with AR
  AugmentedReality::Support::AugmentedReality.jsli::Set Model Height
  Resources::Placeholder.gviweb
diagram:
  while {
    Wait(time to wait=10)
    stop if $Button
  }
  call "Replace Control with AR"(text control selector=".eagle", error in=no error) -> (error out=w1)
  s1 = w1  # shift register
  while {
    call "Set Model Height"(new height=$"Height Offset of Box", error in=s1) -> (error out=w2)
    Wait(time to wait=10)
    next s1 = w2
    stop if w2
  }
  call "Placeholder.gviweb"()
