vi "index.gviweb"   [G Web Development Software 22.0.0]
panel controls:
  "tab": i32
  "tab selector visible?": bool = TRUE
  "listbox": i32 = -1
  "color absolute link": string = "backgrounds/color-absolute.html"
  "color flexible link": string = "backgrounds/color-flexible.html"
  "Gadient flexible link": string = "backgrounds/gradient-flexible.html"
  "Gadient absolute link": string = "backgrounds/gradient-absolute.html"
  "Plain absolute link": string = "backgrounds/plain-absolute.html"
  "Plain flexible link": string = "backgrounds/plain-flexible.html"
  "tree column width": u32 = 100
  "data grid column sorting": enum{"none", "ascending", "descending"} = "none"
  "button": bool
panel indicators:
  "tree": cluster{"location": string}[]
  "data grid": cluster{"Strings": string}[]
uses:
  ControlExtensions::Data Grid - Column by Index - Set Sorting.gvi
  WebApp::Support::Show Error Dialog.gvi
  ControlExtensions::Tab - Selector - Visible.gvi
  ControlExtensions::Tree - Column - Set Width.gvi
  ControlExtensions::Button - Glyph - Create Image URL Style.gvi
  ControlExtensions::Listbox - Items - Enable Tooltip.gvi
  ControlExtensions::Tree - Cells - Enable Tooltip.gvi
diagram:
  while {
    event {
      on "data grid column sorting" Value changed {
        Event Data() -> ("New Value"=w1)
        call "Data Grid - Column by Index - Set Sorting.gvi"(reference in=reference to "data grid", column index=0, sort=w1) -> (error out=w2)
        call "Show Error Dialog.gvi"(error in=w2)
      }
      on "tab selector visible?" Value changed {
        Event Data() -> ("New Value"=w3)
        call "Tab - Selector - Visible.gvi"(reference in=reference to "tab", visible?=w3) -> (error out=w4)
        call "Show Error Dialog.gvi"(error in=w4)
      }
      on "tree column width" Value changed {
        Event Data() -> ("New Value"=w5)
        call "Tree - Column - Set Width.gvi"(reference in=reference to "tree", column index=0, width=w5) -> (error out=w6)
        call "Show Error Dialog.gvi"(error in=w6)
      }
    }
    stop if FALSE
  }
  call "Button - Glyph - Create Image URL Style.gvi"(reference in=reference to "button", url="Support/lightbulb.svg") -> (error out=w7)
  call "Show Error Dialog.gvi"(error in=w7)
  call "Listbox - Items - Enable Tooltip.gvi"(reference in=reference to "listbox") -> (error out=w8)
  call "Show Error Dialog.gvi"(error in=w8)
  call "Tree - Cells - Enable Tooltip.gvi"(reference in=reference to "tree") -> (error out=w9)
  call "Show Error Dialog.gvi"(error in=w9)
