vi "index.gviweb"   [LabVIEW NXG 3.1.0]
panel indicators:
  "name": string[]
  "value": string[]
  "found": bool[]
  "name_2": string[]
  "value_2": string[]
  "found_2": bool[]
  "iframe load time": timestamp
  "iframe load time_2": timestamp
uses:
  DOM::Search::Query Selectors.gvi
  DOM::Tasks::Create Document Fragment.gvi
  DOM::Build::Append Children.gvi
  DOM::Shared::Append Attribute Value Config.gvi
  DOM::Configure::Set Attributes.gvi
  DOM::Configure::Get Attributes.gvi
  DOM::Monitor::Add Event Listener.gvi
  DOM::Monitor::Wait For Event.gvi
  DOM::Monitor::Remove Event Listener.gvi
  DOM::Tasks::Select Element and Replace Contents.gvi
diagram:
  Build Array(".placeholder") -> w1
  call "Query Selectors.gvi"(selectors=w1) -> (element references=w2)
  Array Index(array=w2) -> (out0[_]=w3)
  # Top-Level WebVIs usually contain a While Loop that never stops so that they can continue running as long as the web page is open in the user's web browser.
  while (after w3) {
    Wait(time to wait=50)
    stop if FALSE
  }
  call "Create Document Fragment.gvi"(fragment content="<iframe random=\"lol\"></iframe>", selectors=["iframe"]) -> (fragment reference=w4, element references=w5)
  Build Array(w4) -> w6
  call "Append Children.gvi"(parent reference=w3, child references=w6, clear parent content=TRUE)
  Build Array("src") -> w7
  Array Index(array=w5) -> (out0[_]=w8)
  call "Append Attribute Value Config.gvi"(attribute value="http://www.ni.com") -> (attribute value configs out=w9)
  call "Set Attributes.gvi"(element reference in=w8, attribute names=w7, attribute value configs=w9) -> (element reference out=w10)
  call "Get Attributes.gvi"(element reference in=w10) -> (attribute names out=w11, attribute values out=w12, attribute exist out=w13)
  $name <- w11
  $value <- w12
  $found <- w13
  call "Get Attributes.gvi"(element reference in=w10, attribute names in=["random", "fakenews"]) -> (attribute names out=w14, attribute values out=w15, attribute exist out=w16)
  $name_2 <- w14
  $value_2 <- w15
  $found_2 <- w16
  call "Add Event Listener.gvi"(element reference in=w10, event name="load") -> (event manager reference=w17, error out=w18)
  call "Wait For Event.gvi"(event manager reference in=w17, error in=w18) -> (event manager reference out=w19, error out=w20)
  sequence {
    frame 0 {
      Get Current Time() -> (current time=w21)
      $"iframe load time" <- w21
    }
  }
  call "Remove Event Listener.gvi"(event manager reference=w19, error in=w20)
  call "Create Document Fragment.gvi"(fragment content="<iframe src=\"https://www.reddit.com\"></iframe>", selectors=["iframe"]) -> (element references=w22, error out=w23)
  Array Index(array=w22) -> (out0[_]=w24)
  call "Add Event Listener.gvi"(element reference in=w24, event name="load", error in=w23) -> (element reference out=w25, event manager reference=w26, error out=w27)
  call "Select Element and Replace Contents.gvi"(parent selector=".placeholder2", dom reference=w25, error in=w27) -> (error out=w28)
  call "Wait For Event.gvi"(event manager reference in=w26, error in=w28) -> (property value configs=w29)
  sequence (after w29) {
    frame 0 {
      Get Current Time() -> (current time=w30)
      $"iframe load time_2" <- w30
    }
  }
