vi "svg.gviweb"   [LabVIEW NXG 3.1.0]
uses:
  DOM::Search::Query Selector All.gvi
  DOM::Build::Create Document Fragment.gvi
  DOM::Build::Append Children.gvi
  DOM::Build::Create Elements.gvi
  DOM::Shared::Append Attribute Value Config.gvi
  DOM::Configure::Set Attributes.gvi
diagram:
  call "Query Selector All.gvi"(selector=".placeholder") -> (element references=w1)
  Array Index(array=w1) -> (out0[_]=w2)
  w3 = "<svg height=\"100\" width=\"100\">\n  <circle cx=\"50\" cy=\"50\" r=\"40\" stroke=\"black\" stroke-width=\"3\" fill=\"red\" />\n</svg>"
  call "Create Document Fragment.gvi"(content=w3) -> (document fragment reference=w4)
  Build Array(w4) -> w5
  call "Append Children.gvi"(parent reference in=w2, child references=w5, clear parent content=TRUE)
  call "Query Selector All.gvi"(selector=".placeholder2") -> (element references=w6)
  Array Index(array=w6) -> (out0[_]=w7)
  call "Create Elements.gvi"(tag names=["svg"]) -> (element references=w8)
  Array Index(array=w8) -> (out0[_]=w9)
  call "Append Attribute Value Config.gvi"(attribute value="100") -> (attribute value configs out=w10)
  call "Append Attribute Value Config.gvi"(attribute value configs in=w10, attribute value="100") -> (attribute value configs out=w11)
  call "Set Attributes.gvi"(element reference in=w9, attribute names=["height", "width"], attribute value configs=w11) -> (element reference out=w12)
  # Todo can't use createElement because need a way to pass the namespace, this is a workaround
  # This works because the circle element is created inside an svg context in the document fragment. If it was created outside via createElements or as a circle tag standalone it would be in the html context and fail to work.
  call "Create Document Fragment.gvi"(content="<svg><circle/></svg>") -> (document fragment reference=w13)
  call "Query Selector All.gvi"(dom target reference in (global document)=w13, selector="circle") -> (element references=w14)
  Array Index(array=w14) -> (out0[_]=w15)
  call "Append Attribute Value Config.gvi"(attribute value="50") -> (attribute value configs out=w16)
  call "Append Attribute Value Config.gvi"(attribute value configs in=w16, attribute value="50") -> (attribute value configs out=w17)
  call "Append Attribute Value Config.gvi"(attribute value configs in=w17, attribute value="40") -> (attribute value configs out=w18)
  call "Append Attribute Value Config.gvi"(attribute value configs in=w18, attribute value="black") -> (attribute value configs out=w19)
  call "Append Attribute Value Config.gvi"(attribute value configs in=w19, attribute value="3") -> (attribute value configs out=w20)
  call "Append Attribute Value Config.gvi"(attribute value configs in=w20, attribute value="red") -> (attribute value configs out=w21)
  call "Set Attributes.gvi"(element reference in=w15, attribute names=["cx", "cy", "r", "stroke", "stroke-width", "fill"], attribute value configs=w21) -> (element reference out=w22)
  Build Array(w22) -> w23
  call "Append Children.gvi"(parent reference in=w12, child references=w23) -> (parent reference out=w24)
  Build Array(w24) -> w25
  call "Append Children.gvi"(parent reference in=w7, child references=w25, clear parent content=TRUE)
  while {
    stop if FALSE
  }
