vi "index.gviweb"   [LabVIEW NXG 5.1.0]
panel indicators:
  "Data Grid": cluster{"A": string, "String": string}[]
uses:
  DeclarativeStyle::DataGrid - String Column - Value-Based - Background Color.gvi
  WebApp::Support::Show Error Dialog.gvi
diagram:
  w1 = [{"A"="fail", "String"="fail"}, {"A"="pass", "String"="pass"}]
  $"Data Grid" <- w1
  call "DataGrid - String Column - Value-Based - Background Color.gvi"(selector=".my-element", column index=0, text="pass", color=4278232655) -> (error out=w2)
  call "Show Error Dialog.gvi"(error in=w2)
  while {
    Wait(time to wait=50)
    stop if FALSE
  }
