vi "main.gviweb"   [G Web Development Software 22.3.0]
uses:
  Deno::Current Working Directory Get.gvi
  URL::URL::URL Build Relative Path.gvi
  DenoKV::KV Open.gvi
  DenoHTTP::Simple URL Pattern.gvi
  DenoHTTP::HTTP Create Listeners.gvi
  DenoHTTP::HTTP Wait On Listener.gvi
  DenoHTTP::HTTP Read Request Body String.gvi
  DenoKV::KV Monotonic ULID.gvi
  DenoKV::KV Set String.gvi
  DenoHTTP::HTTP Write Response.gvi
  DenoKV::KV List String.gvi
  DenoHTTP::HTTP Serve Files.gvi
  ChatServer::Support::Simple Log Error.gvi
diagram:
  call "Current Working Directory Get.gvi"() -> (current working directory url=w1)
  call "URL Build Relative Path.gvi"(base url (window location)=w1, relative url="./chat.db") -> (url=w2)
  call "KV Open.gvi"(path url=w2) -> (kv reference=w3, error out=w4)
  call "Simple URL Pattern.gvi"(pathname="/message") -> (url pattern=w5)
  call "Simple URL Pattern.gvi"() -> (url pattern=w6)
  Build Array(w5, w6) -> w7
  call "HTTP Create Listeners.gvi"(url patterns=w7) -> (http listener references=w8, error out=w9)
  Array Index(array=w8) -> (out0[_]=w10, out1[_]=w11)
  while {
    call "HTTP Wait On Listener.gvi"(http listener reference=w10, error in=w4) -> (http connection reference=w12, error out=w13, method=w14)
    case (w14) {
      frame "POST" {
        call "HTTP Read Request Body String.gvi"(http connection reference in=w12, error in=w13) -> (http connection reference out=w15, body=w16, error out=w17)
        call "KV Monotonic ULID.gvi"(error in=w17) -> (monotonic ulid=w18, error out=w19)
        Build Array("messages", w18) -> w20
        call "KV Set String.gvi"(kv reference in=w3, key=w20, value=w16, error in=w19) -> (error out=w21)
        call "HTTP Write Response.gvi"(http connection reference=w15, body="saved", error in=w21)
      }
      frame Default { }
      frame "GET" {
        Build Array("messages") -> w22
        call "KV List String.gvi"(kv reference in=w3, key=w22, limit=20, error in=w13) -> (values=w23, error out=w24)
        Flatten To Json(anything=w23, error in (no error)=w24) -> (JSON string=w25, error out=w26)
        call "HTTP Write Response.gvi"(http connection reference=w12, body=w25, error in=w26)
      }
    }
    stop if FALSE
  }
  call "Current Working Directory Get.gvi"() -> (current working directory url=w27)
  call "URL Build Relative Path.gvi"(base url (window location)=w27, relative url="./Builds/ChatClient_Default Web Server/") -> (url=w28)
  call "HTTP Serve Files.gvi"(http listener reference=w11, root path url=w28, error in=w9) -> (error out=w29)
  call "Simple Log Error.gvi"(error In=w29)
