vi "main.gviweb"   [G Web Development Software 22.3.0]
uses:
  DenoHTTP::Create URL Pattern.gvi
  DenoHTTP::Support::DenoHTTP.jsli::StartServer
  DenoHTTP::Listen for Request.gvi
  DenoHTTP::Complete Request.gvi
  WebApp::Support::Simple Log Error.gvi
  DenoHTTP::Support::DenoHTTP.jsli::RequestUrl
  URL::URL::URL Parameters::URL Get Search Parameter.gvi
  Deno::Support::Deno.jsli::Deno env get
  WebApp::Support::Update Tag.gvi
  DenoHTTP::Support::DenoHTTP.jsli::ServeFileRequests
diagram:
  call "Create URL Pattern.gvi"(pathname="/websocket") -> (url pattern=w1)
  call "Create URL Pattern.gvi"(pathname="/api/systemlink") -> (url pattern=w2)
  call "Create URL Pattern.gvi"(pathname="*") -> (url pattern=w3)
  Build Array(w1, w2, w3) -> w4
  Flatten To Json(anything=w4) -> (JSON string=w5, error out=w6)
  call "StartServer"(urlPatternConfigsJSON=w5, error in=w6) -> (requestListeners=w7, error out=w8)
  Array Index(array=w7) -> (out0[_]=w9, out1[_]=w10, out2[_]=w11)
  s1 = w8  # shift register
  while (iteration -> i1) {
    call "Listen for Request.gvi"(request listener=w9, error in=s1) -> (request handler=w12, error out=w13)
    Format Into String(formatString="done iteration %d", errIn=w13, i1) -> (outString=w14, errOut=w15)
    call "Complete Request.gvi"(request handler=w12, body=w14, error in=w15) -> (error out=w16)
    next s1 = w16
    stop if w16
  }
  call "Simple Log Error.gvi"(error In=s1)
  s2 = w8  # shift register
  while {
    call "Listen for Request.gvi"(request listener=w10, error in=s2) -> (request handler=w17, error out=w18)
    call "RequestUrl"(requestHandler=w17, error in=w18) -> (url=w19, error out=w20)
    call "URL Get Search Parameter.gvi"(url=w19, key="tag-value", error in=w20) -> (value=w21, error out=w22)
    call "Deno env get"(arg="deno-sl-cloud-key") -> (return=w23, error out=w24)
    case (w24) {
      frame Error, Default {
        Concatenate Strings("tag update skipped value:", w21) -> w26
        w25 = w22
      }
      frame No Error {
        call "Update Tag.gvi"(api key=w23, value=w21, error in=w22) -> (error out=w25)
        Concatenate Strings("updated tag value:", w21) -> w26
      }
    }
    call "Complete Request.gvi"(request handler=w17, body=w26, error in=w25) -> (error out=w27)
    next s2 = w27
    stop if w27
  }
  call "Simple Log Error.gvi"(error In=s2)
  call "ServeFileRequests"(requestListener=w11, relativeUrlFromWebAppRoot=".", error in=w8) -> (error out=w28)
  call "Simple Log Error.gvi"(error In=w28)
