vi "index.gviweb"   [LabVIEW NXG 3.1.0]
panel indicators:
  "Output": error
uses:
  ECharts::Core::Create EChart.gvi
  WebApp::Generate Pie Data.gvi
  ECharts::Pie Options::Append Pie Series Options.gvi
  ECharts::Core::Update EChart Options.gvi
  ECharts::Core::Destroy EChart.gvi
diagram:
  call "Create EChart.gvi"(selector=".my-pie-chart") -> (echart refnum=w1, error out=w2)
  s1 = w2  # shift register
  while {
    call "Generate Pie Data.gvi"() -> (pie data=w3)
    call "Append Pie Series Options.gvi"(data=w3) -> (echart options out=w4)
    call "Update EChart Options.gvi"(echart refnum in=w1, echart options=w4, error in=s1) -> (echart refnum out=w5, error out=w6)
    Wait(time to wait=100)
    next s1 = w6
    stop if w6
  }
  call "Destroy EChart.gvi"(echart refnum=w5, error in=s1) -> (error out=w7)
  $Output <- w7
