vi "index.gviweb"   [LabVIEW NXG 5.0.0]
panel controls:
  "Keyboard event on specific elements": string
panel indicators:
  "code": string
  "key": string
  "element code": string
  "element key": string
uses:
  EventTarget::Get Target::Get Target - Document.gvi
  EventTarget::Keyboard::Add Keyboard Event Listener.gvi
  EventTarget::Keyboard::Listen For Keyboard Events.gvi
  EventTarget::Get Target::Get Target - Selector.gvi
diagram:
  call "Get Target - Document.gvi"() -> (document=w1, error out=w2)
  call "Add Keyboard Event Listener.gvi"(target in=w1, keyboard event type="keydown", error in=w2) -> (keyboard user event=w3, target out=w4, error out=w5, event listener configuration out=w6)
  call "Listen For Keyboard Events.gvi"(event listener configuration=w6)
  call "Get Target - Selector.gvi"(selector=".my-element") -> (element=w7, error out=w8)
  call "Add Keyboard Event Listener.gvi"(target in=w7, keyboard event type="keydown", error in=w8) -> (keyboard user event=w9, error out=w10, event listener configuration out=w11)
  Merge Errors(w5, w10) -> (error out=w12)
  Register For Events("keyboard event"=w3, "keyboard event"=w9, error in=w12) -> (error out=w13, event registration refnum out=w14)
  s1 = w13  # shift register
  while {
    event (timeout = 100) (dynamic events = w14) (after w4) {
      on "Timeout" {
        w15 = s1
      }
      on dynamic event 0 {
        Event Data() -> ("code"=w16, "key"=w17)
        $code <- w16
        $key <- w17
        w15 = s1
      }
      on dynamic event 1 {
        Event Data() -> ("code"=w18, "key"=w19)
        $"element code" <- w18
        $"element key" <- w19
        w15 = s1
      }
    }
    next s1 = w15
    stop if w15
  }
  Property Node(instance in=s1) -> ("source"=w20)
  One Button Dialog(message=w20)
  call "Listen For Keyboard Events.gvi"(event listener configuration=w11)
