vi "index.gviweb"   [LabVIEW NXG 5.0.0]
panel controls:
  "capture image": bool
  "load text": bool
  "text": string
  "save text": bool
  "text file name": string
  "load binary": bool
  "binary file name": string
  "save binary": bool
panel indicators:
  "captured image": string
  "number of bytes": i32
  "number of bytes (base64 encoded)": i32
uses:
  File::File Url::Close File Url.gvi
  WebApp::Support::Show Error Dialog.gvi
  FileTasks::Capture Image as File.gvi
  File::File Url::Create File Url.gvi
  File::Close File.gvi
  FileTasks::Read File Text.gvi
  FileTasks::Download File Text.gvi
  FileTasks::Read File Binary.gvi
  Base64::Base64 Encode.gvi
  Base64::Base64 Decode.gvi
  FileTasks::Download File Binary.gvi
diagram:
  s1 = ""  # shift register
  s2 = ""  # shift register
  while {
    event {
      on "capture image" Value changed {
        case (s1) {
          frame Default {
            # cleanup previous snapshot
            call "Close File Url.gvi"(url=s1) -> (error out=w3)
            call "Show Error Dialog.gvi"(error in=w3)
          }
          frame "" { }
        }
        call "Capture Image as File.gvi"() -> (file reference=w4, error out=w5)
        call "Create File Url.gvi"(file reference in=w4, error in=w5) -> (file reference out=w6, file object url=w1, error out=w7)
        $"captured image" <- w1
        call "Close File.gvi"(file reference=w6, error in=w7) -> (error out=w8)
        call "Show Error Dialog.gvi"(error in=w8)
        w2 = s2
      }
      on "load text" Value changed {
        call "Read File Text.gvi"(allowed file types=[".txt"]) -> (file content=w9, file name=w10, error out=w11)
        $text <- w9
        $"text file name" <- w10
        call "Show Error Dialog.gvi"(error in=w11)
        w1 = s1
        w2 = s2
      }
      on "save text" Value changed {
        call "Download File Text.gvi"(file contents=$text, file name=$"text file name") -> (error out=w12)
        call "Show Error Dialog.gvi"(error in=w12)
        w1 = s1
        w2 = s2
      }
      on "load binary" Value changed {
        call "Read File Binary.gvi"() -> (file contents=w13, file name=w14, error out=w15)
        Array Size(array=w13) -> (size(s)=w16)
        $"number of bytes" <- w16
        call "Base64 Encode.gvi"(data=w13, error in=w15) -> (encoded data=w2, error out=w17)
        String Length(string=w2) -> (length=w18)
        $"number of bytes (base64 encoded)" <- w18
        call "Show Error Dialog.gvi"(error in=w17)
        $"binary file name" <- w14
        w1 = s1
      }
      on "save binary" Value changed {
        call "Base64 Decode.gvi"(encoded data=s2) -> (data=w19, error out=w20)
        call "Download File Binary.gvi"(file contents=w19, file name=$"binary file name", error in=w20) -> (error out=w21)
        call "Show Error Dialog.gvi"(error in=w21)
        w1 = s1
        w2 = s2
      }
    }
    next s1 = w1
    next s2 = w2
    stop if FALSE
  }
