vi "Encode JSON.gvi"   [LabVIEW NXG 3.1.0]
inputs:
  "json tokens": "JSON Tokens.gtype"
outputs:
  "json string": string
types:
  "Type.gtype" = enum{"Array", "ArrayEnd", "ArrayDouble", "ArrayString", "ArrayBoolean", "Object", "ObjectKey", "Object End", "Double", "String", "True", "False", "Null"}
  "Token.gtype" = cluster{"type": "Type.gtype", "data": string, "offsets": i32[]}
  "JSON Tokens.gtype" = "Token.gtype"[]
diagram:
  s1 = ""  # shift register
  for {
    w1 = each element of $"json tokens"
    Property Node(instance in=w1) -> ("type"=w2, "data"=w3)
    case (w2) {
      frame "Array" {
        Concatenate Strings(s1, "[") -> w4
      }
      frame "ArrayEnd" {
        Concatenate Strings(s1, "]") -> w4
      }
      frame "ArrayDouble" {
        Concatenate Strings(s1, w3) -> w4
      }
      frame "ArrayString" {
        Concatenate Strings(s1, w3) -> w4
      }
      frame "ArrayBoolean" {
        Concatenate Strings(s1, w3) -> w4
      }
      frame "Object" {
        Concatenate Strings(s1, "{") -> w4
      }
      frame "ObjectKey" {
        Build Array(w3) -> w5
        # TODO: write a proper json string escape instead
        Flatten To JSON(anything=w5) -> (JSON string=w6)
        String Length(string=w6) -> (length=w7)
        Subtract(x=w7, y=2) -> w8
        String Subset(length (rest)=w8, offset (0)=1, string=w6) -> w9
        Concatenate Strings(s1, w9, ":") -> w4
      }
      frame "Object End" {
        Concatenate Strings(s1, "}") -> w4
      }
      frame "Double" {
        Concatenate Strings(s1, w3) -> w4
      }
      frame "String" {
        Build Array(w3) -> w10
        # TODO: write a proper json string escape instead
        Flatten To JSON(anything=w10) -> (JSON string=w11)
        String Length(string=w11) -> (length=w12)
        Subtract(x=w12, y=2) -> w13
        String Subset(length (rest)=w13, offset (0)=1, string=w11) -> w14
        Concatenate Strings(s1, w14) -> w4
      }
      frame "True" {
        Concatenate Strings(s1, "true") -> w4
      }
      frame "False" {
        Concatenate Strings(s1, "false") -> w4
      }
      frame "Null" {
        Concatenate Strings(s1, "") -> w4
      }
    }
    next s1 = w4
  }
  $"json string" <- s1
