vi "Parse JSON.gvi"   [LabVIEW NXG 3.1.0]
inputs:
  "json string": string
  "error in": error
outputs:
  "json tokens": "JSON Tokens.gtype"
  "error out": error
types:
  "Type.gtype" = enum{"Array", "ArrayEnd", "ArrayDouble", "ArrayString", "ArrayBoolean", "Object", "ObjectKey", "Object End", "Double", "String", "True", "False", "Null"}
  "Token.gtype" = cluster{"Type": "Type.gtype", "Data": string, "Offsets": i32[]}
  "JSON Tokens.gtype" = "Token.gtype"[]
uses:
  JSONParser::Support::JSONParser.jsli::JSONTokenize
diagram:
  call "JSONTokenize"(jsonString=$"json string", error in=$"error in") -> (tokensJSON=w1, error out=w2)
  Unflatten From JSON(JSON string=w1, error in (no error)=w2, type and defaults=cluster{"T": u16, "D": string, "O": i32[]}[] []) -> (error out=w3, value=w4)
  $"json tokens" <- w4
  $"error out" <- w3
