vi "index.gviweb"   [LabVIEW NXG 3.1.0]
panel controls:
  "Stop": bool
uses:
  Leaflet::Leaflet.jsli::CreateMap
  Leaflet::Leaflet.jsli::DestroyMap
diagram:
  call "CreateMap"(selector=".leaflet-map") -> (refnum=w1, error out=w2)
  s1 = w2  # shift register
  while {
    case (s1) {
      frame Error, Default {
        w3 = FALSE
        w4 = s1
        w5 = w1
      }
      frame No Error {
        event {
          on "Stop" Value changed {
            w3 = $Stop
            w4 = s1
            w5 = w1
          }
        }
      }
    }
    Logical Or(w4, w3) -> w6
    next s1 = w4
    stop if w6
  }
  call "DestroyMap"(refnum=w5, error in=s1)
