vi "index.gviweb"   [G Web Development Software 22.0.0]
panel controls:
  "interval (ms)": f64
uses:
  Perspective::Viewer::Viewer Create.gvi
  Perspective::Table::Table Create.gvi
  Perspective::Viewer::Viewer Load.gvi
  Perspective::Table::Table Update.gvi
diagram:
  call "Viewer Create.gvi"(container=reference to "HTML Container") -> (viewer reference=w1)
  w2 = [{"name"="x", "column type"="float"}, {"name"="y", "column type"="float"}]
  call "Table Create.gvi"(schema=w2) -> (table reference=w3)
  call "Viewer Load.gvi"(viewer reference in=w1, table reference=w3)
  while (iteration -> i1) {
    Build Array(i1) -> w4
    Divide(x=i1, y=f64 default) -> w5
    Sine(x=w5) -> w6
    Multiply(w6, 10) -> w7
    Build Array(w7) -> w8
    Property Node(instance in=cluster{"x": f64[], "y": f64[]} {all zero or empty}, "x"=w4, "y"=w8) -> (instance out=w9)
    call "Table Update.gvi"(table reference in=w3, data=w9)
    Wait(time to wait=$"interval (ms)")
    stop if FALSE
  }
