vi "Create Quill.gvi"   [LabVIEW NXG 3.1.0]
# Creates a Quill based rich text area.
# Use the supported formats input to enable the formats that will be possible in the quill editor.
# Use the hidden toolbar formats input to hide any of the enabled formats from the toolbar.
inputs:
  "selector": string, required
  "error in": error
  "supported formats": string[] = ["font", "size", "spacer", "bold", "italic", "underline", "strike", "spacer", "color", "background", "spacer", "script", "spacer", "code", "link", "spacer", "header", "blockquote", "code-block", "spacer", "list", "indent", "spacer", "direction", "align", "spacer", "formula", "image", "video", "clean"]
  "disabled": bool
outputs:
  "quill reference": "quill reference.gtype"
  "error out": error
types:
  "quill reference.gtype" = i32
uses:
  Quill::Support::Quill.jsli::CreateQuill
diagram:
  Flatten To JSON(anything=$"supported formats") -> (JSON string=w1)
  call "CreateQuill"(selector=$selector, formatsJSON=w1, disabled=$disabled, error in=$"error in") -> (quillReference=w2, error out=w3)
  $"quill reference" <- w2
  $"error out" <- w3
