vi "ckeditor.gviweb"   [LabVIEW NXG 3.1.0]
panel controls:
  "Submit": bool
panel indicators:
  "ckeditor input": string
  "ckeditor output": string
  "content": string
uses:
  CKEditor4::Create CKEditor.gvi
  CKEditor4::Get Content.gvi
  CKEditor4::Set Content.gvi
diagram:
  call "Create CKEditor.gvi"(disabled=TRUE, selector=".my-ckeditor-output") -> (ckeditor reference=w1)
  call "Create CKEditor.gvi"(selector=".my-ckeditor-input") -> (ckeditor reference=w2)
  while {
    event {
      on "Submit" Value changed {
        call "Get Content.gvi"(ckeditor reference in=w2) -> (content=w3)
        $content <- w3
        call "Set Content.gvi"(ckeditor reference in=w1, content=w3)
      }
    }
    stop if FALSE
  }
