vi "quill.gviweb"   [LabVIEW NXG 3.1.0]
panel controls:
  "submit": bool
panel indicators:
  "quill input": string
  "quill output": string
  "deltas json": string
uses:
  Quill::Create Quill.gvi
  Quill::Get Content.gvi
  Quill::Set Content.gvi
diagram:
  call "Create Quill.gvi"(selector=".my-quill-input") -> (quill reference=w1)
  call "Create Quill.gvi"(disabled=TRUE, selector=".my-quill-output") -> (quill reference=w2)
  while {
    event {
      on "submit" Value changed {
        call "Get Content.gvi"(quill reference in=w1) -> (deltas json=w3)
        $"deltas json" <- w3
        call "Set Content.gvi"(quill reference in=w2, deltas json=w3)
      }
    }
    stop if FALSE
  }
