vi "index.gviweb"   [LabVIEW NXG 3.1.0]
panel controls:
  "Button": bool
panel indicators:
  "error out": error
  "Array Constant": u8[]
uses:
  Uppy::Uppy::Create Uppy.gvi
  Uppy::Uppy::Set Uppy Core Options.gvi
  Uppy::Uppy::Set Uppy Webcam Options.gvi
  Uppy::Uppy::Request Uppy Files.gvi
  Uppy::Uppy File::Read Uppy File.gvi
  Uppy::Uppy File::Destroy Uppy Files.gvi
  Uppy::Uppy::Destroy Uppy.gvi
diagram:
  while {
    event {
      on "Button" Value changed {
        call "Create Uppy.gvi"() -> (uppy refnum=w2, error out=w3)
        call "Set Uppy Core Options.gvi"(uppy refnum in=w2, error in=w3, max number of files=1, allowed file types=["image/*"]) -> (uppy refnum out=w4, error out=w5)
        call "Set Uppy Webcam Options.gvi"(uppy refnum in=w4, error in=w5) -> (uppy refnum out=w6, error out=w7)
        call "Request Uppy Files.gvi"(uppy refnum in=w6, error in=w7) -> (uppy refnum out=w8, uppy file refnums=w9, error out=w10)
        s1 = w10  # shift register
        for {
          w11 = each element of w9
          call "Read Uppy File.gvi"(uppy file refnum in=w11, error in=s1) -> (uppy file refnum out=w13, file contents=w14, error out=w15)
          $"Array Constant" <- w14
          append w13 to w12
          next s1 = w15
          stop if w15
        }
        call "Destroy Uppy Files.gvi"(uppy file refnums=w12, error in=s1) -> (error out=w16)
        call "Destroy Uppy.gvi"(uppy refnum=w8, error in=w16) -> (error out=w1)
      }
    }
    stop if w1
  }
  $"error out" <- w1
