vi "index.gviweb"   [LabVIEW NXG 5.0.0]
panel controls:
  "Button": bool
panel indicators:
  "time": waveform<f32>
  "frequency": waveform<f32>
uses:
  WebAudio::Create Media Stream Audio Source Node.gvi
  WebAudio::Create Analyzer.gvi
  WebAudio::Get Sample Rate.gvi
  WebAudio::Get Analyser Frequency Data.gvi
  WebAudio::Get Analyser Time Domain Data.gvi
diagram:
  sequence {
    frame 0 {
      while {
        Wait(time to wait=500)
        stop if $Button
      }
    }
    frame 1 {
      call "Create Media Stream Audio Source Node.gvi"() -> (audio node reference=w1, error out=w2)
      call "Create Analyzer.gvi"(audio node reference=w1, error in=w2) -> (analyser reference=w3, error out=w4)
    }
  }
  call "Get Sample Rate.gvi"(error in=w4) -> (sample rate=w5, error out=w6)
  s1 = w6  # shift register
  while {
    call "Get Analyser Frequency Data.gvi"(analyser reference=w3, error in=s1) -> (frequency data=w7, error out=w8)
    call "Get Analyser Time Domain Data.gvi"(analyser reference=w3, error in=w8) -> (time domain data=w9, error out=w10)
    Reciprocal(x=w5) -> w11
    Multiply(w11, 1000) -> w12
    Build Waveform Node(Y=w9, dt=w12) -> (output waveform=w13)
    $time <- w13
    To Double Precision Float(number=w5) -> w14
    Divide(x=w14, y=2) -> w15
    Array Size(array=w7) -> (size(s)=w16)
    To Double Precision Float(number=w16) -> w17
    Divide(x=w15, y=w17) -> w18
    Build Waveform Node(Y=w7, dt=w18) -> (output waveform=w19)
    $frequency <- w19
    Wait(time to wait=10)
    next s1 = w10
    stop if w10
  }
  Property Node(instance in=s1) -> ("source"=w20)
  One Button Dialog(message=w20)
