vi "BatteryLevel.gviweb"   [LabVIEW NXG 5.0.0]
panel controls:
  "connect to battery": bool
panel indicators:
  "value": u8[]
  "id": string
  "name": string
uses:
  WebBluetooth::UUID::Service UUID (String).gvi
  WebBluetooth::Filter::Set Filter Services.gvi
  WebBluetooth::Request Device.gvi
  WebBluetooth::GATT Server Connect.gvi
  WebBluetooth::Get Primary Service.gvi
  WebBluetooth::UUID::Characteristic UUID (String).gvi
  WebBluetooth::Get Characteristic.gvi
  WebBluetooth::Read Value.gvi
  WebBluetooth::GATT Server Disconnect.gvi
diagram:
  while {
    event {
      on "connect to battery" Value changed {
        call "Service UUID (String).gvi"(name="battery_service") -> (uuid=w2)
        Build Array(w2) -> w3
        call "Set Filter Services.gvi"(service uuids=w3) -> (filter out=w4)
        Build Array(w4) -> w5
        call "Request Device.gvi"(filters=w5) -> (device reference=w6, error out=w7)
        call "GATT Server Connect.gvi"(device reference in=w6, error in=w7) -> (device reference out=w8, error out=w9)
        call "Service UUID (String).gvi"(name="battery_service") -> (uuid=w10)
        call "Get Primary Service.gvi"(device reference in=w8, service uuid=w10, error in=w9) -> (service reference=w11, error out=w12)
        call "Characteristic UUID (String).gvi"(name="battery_level") -> (uuid=w13)
        call "Get Characteristic.gvi"(service reference in=w11, characteristic uuid=w13, error in=w12) -> (characteristic reference=w14, error out=w15)
        sequence {
          frame 0 {
            call "Read Value.gvi"(characteristic reference in=w14, error in=w15) -> (value=w16, error out=w17)
            $value <- w16
          }
        }
        call "GATT Server Disconnect.gvi"(device reference=w6, error in=w17) -> (error out=w1)
      }
    }
    stop if w1
  }
  Property Node(instance in=w1) -> ("source"=w18)
  One Button Dialog(message=w18)
